# Dynamo graph 공통_Load Distribution_1.0.0.dyn (Dynamo 2.16.1.2727)

rooms_by_status = RoomsByStatus()
coreCenterBoundary = Room.CoreCenterBoundary(room=rooms_by_status.PlacedRooms)
byJoinedCurves = PolyCurve.ByJoinedCurves(curves=coreCenterBoundary)
categories = Categories("OST_StructuralFraming")
all_elements_of_category = ElementsOfCategory(Category=categories)
code_block = CodeBlock { "Reference Level"; }
getParameterValueByName = Element.GetParameterValueByName(element=all_elements_of_category, parameterName=code_block)
getLocation = Element.GetLocation(element=all_elements_of_category)
startPoint = Curve.StartPoint(curve=getLocation)
perimeterCurves = Surface.PerimeterCurves()  # unwired: surface
parameters = Element.Parameters(element=rooms_by_status.PlacedRooms)
find_closed_loop = Python()  # CPython3; frozen; unwired: IN[0]
# ---------- find_closed_loop.python (65 lines) ----------
# Load the Python Standard and DesignScript Libraries
import sys
import clr
clr.AddReference('ProtoGeometry')
from Autodesk.DesignScript.Geometry import *

from copy import deepcopy
from itertools import groupby
from itertools import chain
#################################Module For Functional Programing#############################################
from functools import reduce
curry = lambda f: lambda a,*args: f(a, *args) if (len(args)) else lambda *args: f(a, *args)

filter = curry(filter)
map = curry(map)

def _take(length, iter):
    res = []
    for a in iter:
        res.append(a)
        if len(res) == length:
            return res
        
take = curry(_take)
reduce = curry(reduce)

go = lambda *args: reduce(lambda a,f: f(a), args) ## 함수도 축약 가능 ##
##############################################################################################################
# The inputs to this node will be stored as a list in the IN variables.
dataEnteringNode = IN
frameLocs_perLevel = IN[0][1]
# Place your code below this line

def sort_ByDirection(col, func):
    res = sorted(col, key = func)
    
    return res

def find_closed(locs):
    res = []
    #tgtList = deepcopy(locs)
    for i in locs:       
        primeIntsct = go\
        (   
            locs,
            filter( lambda x: i != x ),
            filter( lambda x: i.DoesIntersect(x) ),
            filter( lambda x: not(i.Direction.IsParallel(x.Direction)) ),
            map( lambda x: x.Length ),
            list,
#            map( lambda x: [x.StartPoint, x.EndPoint] ),
#            lambda x: list(chain(*x)),
#            set,
        )
        #srf = i.Extrude(round(primeIntsct[0]))
        #primeIntsct.insert(0,i)
        

        #res.append(srf)
        res.append(round(primeIntsct[0]))
    return res
            
# Assign your output to the OUT variable.
#OUT = sort_ByDirection(frameLocs_perLevel, lambda x: [round(x.Direction.X), round(x.Direction.Y)])
OUT = find_closed(frameLocs_perLevel)
# ----------------------------------------
select_divided_surface_families = DSDividedSurfaceFamiliesSelection()  # nothing selected
select_model_element_by_category = DSModelElementByCategorySelection("OST_Roofs")  # 1 picked in the model
geometry = Element.Geometry(element=select_model_element_by_category)
getBottomCrv = Python(IN[0]=geometry)  # CPython3
# ---------- getBottomCrv.python (43 lines) ----------
# Load the Python Standard and DesignScript Libraries
import sys
import clr
clr.AddReference('ProtoGeometry')
from Autodesk.DesignScript.Geometry import *

#################################Module For Functional Programing#############################################
from functools import reduce
curry = lambda f: lambda a,*args: f(a, *args) if (len(args)) else lambda *args: f(a, *args)

filter = curry(filter)
map = curry(map)

def _take(length, iter):
    res = []
    for a in iter:
        res.append(a)
        if len(res) == length:
            return res
        
take = curry(_take)
reduce = curry(reduce)

go = lambda *args: reduce(lambda a,f: f(a), args) ## 함수도 축약 가능 ##
##############################################################################################################

# The inputs to this node will be stored as a list in the IN variables.
dataEnteringNode = IN
geo = IN[0][0]
# Place your code below this line

def getBtmCrvs(geo):
    btmSrf = go\
    (
        geo.Explode(),
        filter(lambda x:round(x.NormalAtParameter(0.5,0.5).Z, 4)==-1),
        list,
        lambda x: x[0].PerimeterCurves(),
    )
    
    return btmSrf
# Assign your output to the OUT variable.
OUT = getBtmCrvs(geo)
# ----------------------------------------
explode = Geometry.Explode()  # unwired: geometry
normalAtParameter = Surface.NormalAtParameter()  # unwired: surface
perimeterCurves_2 = Surface.PerimeterCurves()  # unwired: surface
