# Dynamo graph 2-1_Room Separator(221201).dyn (Dynamo 2.13.1.3887)

code_block = CodeBlock { {}; }
code_block_2 = CodeBlock { "box obj"; }

# group: Generic Mass & Level select
categories = Categories("OST_GenericModel")
all_elements_of_category = ElementsOfCategory(Category=categories)

# group: get obj
# set Dictionary
mkNewDicts = Python(IN[0]=code_block, IN[1]=code_block_2, IN[2]=all_elements_of_category)  # CPython3
# ---------- mkNewDicts.python (32 lines) ----------
# Load the Python Standard and DesignScript Libraries
import sys
import clr
clr.AddReference('ProtoGeometry')
from Autodesk.DesignScript.Geometry import *

# The inputs to this node will be stored as a list in the IN variables.
dataEnteringNode = IN

preDicts = IN[0]
newKey = IN[1]
newValues = IN[2]

# Place your code below this line

def mkNewDicts(preDicts, newKey, newValues):
    if preDicts == {}:
        preDicts = []
        list(map(lambda x: preDicts.append({}), newValues))
    else:
        pass

    dict_valuePairs = zip(preDicts, newValues)
    
    def mkNewDict(_dict, _key, _value):
        _dict[_key] = _value
        return _dict
    
    result = map(lambda x: mkNewDict(x[0], newKey, x[1]), dict_valuePairs)
    return result
# Assign your output to the OUT variable.
OUT = mkNewDicts(preDicts, newKey, newValues)
# ----------------------------------------

code_block_3 = CodeBlock(d=mkNewDicts) { d; }
code_block_4 = CodeBlock { "box obj"; }
valueAtKey = DesignScript.Builtin.Dictionary.ValueAtKey(dictionary=code_block_3, key=code_block_4)
code_block_5 = CodeBlock { "Level"; }
getParameterValueByName = Element.GetParameterValueByName(element=valueAtKey, parameterName=code_block_5)
string_from_object = FromObject(object=getParameterValueByName)
innerPerimeterCurves = AnalyticalAutomation.Geometry.Surface.InnerPerimeterCurves()  # unwired: surface
code_block_6 = CodeBlock { "box lv"; }
name = Level.Name(level=getParameterValueByName)

# group: box level추출
# set Dictionary
mkNewDicts_2 = Python(IN[0]=code_block_3, IN[1]=code_block_6, IN[2]=name)  # CPython3; same code as mkNewDicts

code_block_7 = CodeBlock(d=mkNewDicts_2) { d; }
code_block_8 = CodeBlock { "box cenPoint"; }
code_block_9 = CodeBlock { "box obj"; }
valueAtKey_2 = DesignScript.Builtin.Dictionary.ValueAtKey(dictionary=code_block_7, key=code_block_9)
getLocation = Element.GetLocation(element=valueAtKey_2)

# group: box 기준점 추출
# set Dictionary
mkNewDicts_3 = Python(IN[0]=code_block_7, IN[1]=code_block_8, IN[2]=getLocation)  # CPython3; same code as mkNewDicts

code_block_10 = CodeBlock(d=mkNewDicts_3) { d; }
code_block_11 = CodeBlock { "box refPlane"; }
code_block_12 = CodeBlock { "box cenPoint"; }
valueAtKey_3 = DesignScript.Builtin.Dictionary.ValueAtKey(dictionary=code_block_10, key=code_block_12)
byOriginNormal = Plane.ByOriginNormal(origin=valueAtKey_3)

# group: box 작업평면 추출
# set Dictionary
mkNewDicts_4 = Python(IN[0]=code_block_10, IN[1]=code_block_11, IN[2]=byOriginNormal)  # CPython3; same code as mkNewDicts

code_block_13 = CodeBlock(d=mkNewDicts_4) { d; }
code_block_14 = CodeBlock { "box btmSrf"; }
code_block_15 = CodeBlock { "box refPlane"; }
valueAtKey_4 = DesignScript.Builtin.Dictionary.ValueAtKey(dictionary=code_block_13, key=code_block_15)
code_block_16 = CodeBlock { "box obj"; }
valueAtKey_5 = DesignScript.Builtin.Dictionary.ValueAtKey(dictionary=code_block_13, key=code_block_16)
geometry = Element.Geometry(element=valueAtKey_5)
intersect = Geometry.Intersect(geometry=valueAtKey_4, other=geometry, lacing=Shortest)
flatten = List.Flatten(list=intersect)

# group: box 하부면 추출
# set Dictionary
mkNewDicts_5 = Python(IN[0]=code_block_13, IN[1]=code_block_14, IN[2]=flatten)  # CPython3; same code as mkNewDicts

code_block_17 = CodeBlock(d=mkNewDicts_5) { d; }
code_block_18 = CodeBlock { "box btmSrf"; }
valueAtKey_6 = DesignScript.Builtin.Dictionary.ValueAtKey(dictionary=code_block_17, key=code_block_18)
outerPerimeterCurves = AnalyticalAutomation.Geometry.Surface.OuterPerimeterCurves(surface=valueAtKey_6)
code_block_19 = CodeBlock { "box btmEdgeCrv"; }
perimeterCurves = Surface.PerimeterCurves(surface=valueAtKey_6)

# group: 매스별 바운더리 라인 추출
# set Dictionary
mkNewDicts_6 = Python(IN[0]=code_block_17, IN[1]=code_block_19, IN[2]=perimeterCurves)  # CPython3; same code as mkNewDicts

code_block_20 = CodeBlock(d=mkNewDicts_6) { d; }
code_block_21 = CodeBlock { "box btmEdgeCrv"; }
valueAtKey_7 = DesignScript.Builtin.Dictionary.ValueAtKey(dictionary=code_block_20, key=code_block_21)
code_block_22 = CodeBlock { "box lv"; }
valueAtKey_8 = DesignScript.Builtin.Dictionary.ValueAtKey(dictionary=code_block_20, key=code_block_22)
groupByKey = List.GroupByKey(list=valueAtKey_7, keys=valueAtKey_8)
flatten_2 = List.Flatten(list=groupByKey.groups@L3)
code_block_23 = CodeBlock { "box refPlane"; }
valueAtKey_9 = DesignScript.Builtin.Dictionary.ValueAtKey(dictionary=code_block_20, key=code_block_23)
groupByKey_2 = List.GroupByKey(list=valueAtKey_9, keys=valueAtKey_8)
firstItem = List.FirstItem(list=groupByKey_2.groups@L2)
byPlane = SketchPlane.ByPlane(plane=firstItem)
code_block_24 = CodeBlock { {}; }
code_block_25 = CodeBlock { "used viewObj"; }
code_block_26 = CodeBlock(d=mkNewDicts_2) { d; }
code_block_27 = CodeBlock { "box lv"; }
valueAtKey_10 = DesignScript.Builtin.Dictionary.ValueAtKey(dictionary=code_block_26, key=code_block_27)

# group: 사용된 뷰 필터링 알고리즘
categories_2 = Categories("OST_Views")
all_elements_of_category_2 = ElementsOfCategory(Category=categories_2)
boolean = BoolSelector(false)
clean = List.Clean(list=all_elements_of_category_2, preserveIndices=boolean)
string_from_object_2 = FromObject(object=clean)
code_block_28 = CodeBlock { "FloorPlanView"; }
contains = String.Contains(string=string_from_object_2, searchFor=code_block_28, lacing=CrossProduct)
filterByBoolMask = List.FilterByBoolMask(list=clean, mask=contains)
name_2 = Element.Name(element=filterByBoolMask.in)
uniqueItems = List.UniqueItems(list=valueAtKey_10)
contains_2 = String.Contains(string=name_2, searchFor=uniqueItems, lacing=CrossProduct)
anyTrue = List.AnyTrue(list=contains_2@L2)
filterByBoolMask_2 = List.FilterByBoolMask(list=filterByBoolMask.in, mask=anyTrue)

# group: get obj
# set Dictionary
mkNewDicts_7 = Python(IN[0]=code_block_24, IN[1]=code_block_25, IN[2]=filterByBoolMask_2.in)  # CPython3; same code as mkNewDicts

code_block_29 = CodeBlock(d=mkNewDicts_7) { d; }
code_block_30 = CodeBlock { "used viewObj"; }
valueAtKey_11 = DesignScript.Builtin.Dictionary.ValueAtKey(dictionary=code_block_29, key=code_block_30)

# group: RoomSeparator.FromCurve
code_block_31 = CodeBlock(i=flatten_2, sketchPlane=byPlane, view=valueAtKey_11) { i; sketchPlane; view; }
python_script = Python(IN[0]=code_block_31.i, IN[1]=code_block_31.sketchPlane, IN[2]=code_block_31.view)  # CPython3
# ---------- python_script.python (51 lines) ----------
import clr
clr.AddReference('RevitAPI')
from Autodesk.Revit.DB import *

clr.AddReference("RevitNodes")
import Revit
clr.ImportExtensions(Revit.GeometryConversion)

clr.AddReference("RevitServices")
import RevitServices
from RevitServices.Persistence import DocumentManager
from RevitServices.Transactions import TransactionManager

doc = DocumentManager.Instance.CurrentDBDocument
curveslist = UnwrapElement(IN[0])
sketchplaneslist = UnwrapElement(IN[1])
viewslist = UnwrapElement(IN[2])

def createRoomSeparator(curves, sketchplane, view):
    curvearray = CurveArray()
    for curve in curves:
    	curvearray.Append(curve.ToRevitType())
    doccreation = doc.Create
    separatorarray = doccreation.NewRoomBoundaryLines(sketchplane, curvearray, view)
    elementlist = []
    for item in separatorarray:
    	elementlist.append(item)
    
    return elementlist


TransactionManager.Instance.EnsureInTransaction(doc)

if len(curveslist) > 1:
    result = []
    for i in range(len(curveslist)):
        uni = createRoomSeparator(curveslist[i], sketchplaneslist[i], viewslist[i])
        result.append(uni)
else:
    result = createRoomSeparator(curveslist, sketchplaneslist, viewslist)

#result = createRoomSeparator(curveslist, sketchplaneslist, viewslist)

TransactionManager.Instance.TransactionTaskDone()
    





OUT = result
# ----------------------------------------
